# Grasshopper definition Greeble.gh (Grasshopper 0.9.76)
# plug-ins: LunchBox, Weaverbird

pt = ConstructPoint(XCoordinate=0, YCoordinate=0, ZCoordinate=0)
number_slider = Slider(5, range=0..10)
series = Series(Start=0, Step=1, Count=10)
c_script = CSharpScript(
    x=number_slider,
    Reference=["C:\Program Files\Common Files\McNeel\Rhinoceros\5.0\Plug-ins\Grasshopper (b45a29b1-4343-4035-989e-044e8580d9cf)\0.9.76.0\Components\Triangulation.gha", "C:\Program Files\Common Files\McNeel\Rhinoceros\5.0\Plug-ins\Grasshopper (b45a29b1-4343-4035-989e-044e8580d9cf)\0.9.76.0\Components\Surface.gha", "C:\Program Files\Common Files\McNeel\Rhinoceros\5.0\Plug-ins\Grasshopper (b45a29b1-4343-4035-989e-044e8580d9cf)\0.9.76.0\Components\Mathematics.gha"])  # -> out, A, B; inputs x: Int32
# ---------- c_script: C# ----------
    var points = new List<Point3d>();

    for( int i = 0; i < x; ++i )
      for( int j = 0; j < x; ++j )
      {

        points.Add(new Point3d(i, j, 0.5 * ( Math.Sin(i) * Math.Cos(j) )));

      }

    var delaunayMesh = new TriangulationComponents.Component_Delaunay();

    var delPoints = delaunayMesh.Params.Input[0] as Grasshopper.Kernel.GH_PersistentGeometryParam<Grasshopper.Kernel.Types.GH_Point>;
    delPoints.PersistentData.ClearData();
    for(int i = 0; i < points.Count; ++i)
    {

      delPoints.PersistentData.Append(new GH_Point(points[i]));

    }

    delaunayMesh.ExpireSolution(true);

    var doc = new Grasshopper.Kernel.GH_Document();
    doc.AddObject(delaunayMesh, false);

    delaunayMesh.Params.Output[0].CollectData();

    var delaunay = delaunayMesh.Params.Output[0].VolatileData.get_Branch(0)[0];

    var ghMesh = new Grasshopper.Kernel.Types.GH_Mesh();

    Grasshopper.Kernel.GH_Convert.ToGHMesh(delaunay, GH_Conversion.Both, ref ghMesh);

    var rhinoMesh = new Mesh();

    Grasshopper.Kernel.GH_Convert.ToMesh(delaunay, ref rhinoMesh, GH_Conversion.Both);

    var faceA = new int[rhinoMesh.Faces.Count];
    var faceB = new int[rhinoMesh.Faces.Count];
    var faceC = new int[rhinoMesh.Faces.Count];
    var faceD = new int[rhinoMesh.Faces.Count];

    for( int i = 0; i < rhinoMesh.Faces.Count; ++i )
    {

      faceA[i] = rhinoMesh.Faces[i].A;
      faceB[i] = rhinoMesh.Faces[i].B;
      faceC[i] = rhinoMesh.Faces[i].C;
      faceD[i] = rhinoMesh.Faces[i].D;

    }

    var faceMesh = new List<object>();
    var verticesMesh = new List<object>();
    var normalMesh = new List<object>();

    var deMesh = new SurfaceComponents.MeshComponents.Component_DeconstructMesh();
    var meshParams = deMesh.Params.Input[0] as Grasshopper.Kernel.GH_PersistentParam<Grasshopper.Kernel.Types.GH_Mesh>;
    meshParams.PersistentData.ClearData();
    meshParams.PersistentData.Append(ghMesh);

    deMesh.ExpireSolution(true);
    //var docTwo = new Grasshopper.Kernel.GH_Document();
    doc.AddObject(deMesh, false);
    deMesh.Params.Output[0].CollectData();
    var rhinoVerMesh = new Point3d[deMesh.Params.Output[0].VolatileDataCount];
    var rhinoNorMesh = new Vector3d[deMesh.Params.Output[0].VolatileDataCount];
    for (int i = 0; i < deMesh.Params.Output[0].VolatileDataCount; ++i)
    {

      verticesMesh.Add(deMesh.Params.Output[0].VolatileData.get_Branch(0)[i]);
      Grasshopper.Kernel.GH_Convert.ToPoint3d(verticesMesh[i], ref rhinoVerMesh[i], GH_Conversion.Both);

    }
    for (int i = 0; i < deMesh.Params.Output[1].VolatileDataCount; ++i)
    {

      faceMesh.Add(deMesh.Params.Output[1].VolatileData.get_Branch(0)[i]);

    }
    for (int i = 0; i < deMesh.Params.Output[3].VolatileDataCount; ++i)
    {

      normalMesh.Add(deMesh.Params.Output[3].VolatileData.get_Branch(0)[i]);
      Grasshopper.Kernel.GH_Convert.ToVector3d(normalMesh[i], ref rhinoNorMesh[i], GH_Conversion.Both);

    }

    var deFace = new SurfaceComponents.MeshComponents.Component_DeconstructFace();
    var deFaceParams = deFace.Params.Input[0] as Grasshopper.Kernel.GH_PersistentParam<Grasshopper.Kernel.Types.GH_MeshFace>;
    deFaceParams.PersistentData.ClearData();
    for( int i = 0; i < faceMesh.Count; ++i )
    {

      deFaceParams.PersistentData.Append(faceMesh[i]);

    }

    var listA = new List<Point3d>();
    var listB = new List<Point3d>();
    var listC = new List<Point3d>();
    var listD = new List<Point3d>();
    for( int i = 0; i < faceA.Length; ++i )
    {

      listA.Add(ListItem(rhinoVerMesh.ToList(), faceA[i]));
      listB.Add(ListItem(rhinoVerMesh.ToList(), faceB[i]));
      listC.Add(ListItem(rhinoVerMesh.ToList(), faceC[i]));
      listD.Add(ListItem(rhinoVerMesh.ToList(), faceD[i]));

    }

    var surFourPoints = new SurfaceComponents.SurfaceComponents.Component_4PointSurface();
    var surFourParamsA = surFourPoints.Params.Input[0] as Grasshopper.Kernel.GH_PersistentGeometryParam<Grasshopper.Kernel.Types.GH_Point>;
    surFourParamsA.PersistentData.ClearData();
    var surFourParamsB = surFourPoints.Params.Input[1] as Grasshopper.Kernel.GH_PersistentGeometryParam<Grasshopper.Kernel.Types.GH_Point>;
    surFourParamsB.PersistentData.ClearData();
    var surFourParamsC = surFourPoints.Params.Input[2] as Grasshopper.Kernel.GH_PersistentGeometryParam<Grasshopper.Kernel.Types.GH_Point>;
    surFourParamsC.PersistentData.ClearData();
    var surFourParamsD = surFourPoints.Params.Input[3] as Grasshopper.Kernel.GH_PersistentGeometryParam<Grasshopper.Kernel.Types.GH_Point>;
    surFourParamsD.PersistentData.ClearData();
    for(int i = 0; i < listA.Count; ++i)
    {

      surFourParamsA.PersistentData.Append(new GH_Point(listA[i]));
      surFourParamsB.PersistentData.Append(new GH_Point(listB[i]));
      surFourParamsC.PersistentData.Append(new GH_Point(listC[i]));
      surFourParamsD.PersistentData.Append(new GH_Point(listD[i]));

    }

    var surfaceFourPoints = new List<object>();
    var surfaces = new Grasshopper.Kernel.Types.GH_Surface[listA.Count];
    var breps = new Rhino.Geometry.Brep[listA.Count];
    var curves = new List<CurveList>();

    surFourPoints.ExpireSolution(true);
    doc.AddObject(surFourPoints, false);
    surFourPoints.Params.Output[0].CollectData();
    var sur4Pt = new Point3d[surFourPoints.Params.Output[0].VolatileDataCount];
    for (int i = 0; i < surFourPoints.Params.Output[0].VolatileDataCount; ++i)
    {

      surfaceFourPoints.Add(surFourPoints.Params.Output[0].VolatileData.get_Branch(0)[i]);
      Grasshopper.Kernel.GH_Convert.ToGHSurface(surfaceFourPoints[i], GH_Conversion.Both, ref surfaces[i]);
      Grasshopper.Kernel.GH_Convert.ToBrep(surfaces[i], ref breps[i], GH_Conversion.Both);
      curves.Add(Curves(breps[i]));

    }

    /*
    var center = new Point3d[surfaceFourPoints.Count];
    for( int i = 0; i < center.Length; ++i )
    {

      center[i] = AreaMassProperties.Compute(curves.ElementAt(i)).Centroid;

    }


    A = center;

    //var curve = surfaces[0].IsoCurve(0, 2.0);
    */
    
    var curve = breps[0].GetWireframe(0);
    var crv = Curve.JoinCurves(curve)[0];
    A = Surface.CreateExtrusion(crv, rhinoNorMesh[0]);
    
    B = crv;
# ---------- c_script: C# additional code ----------
  private Point3d ListItem(List<Point3d> points, int faceIndex)
  {

    if(faceIndex > points.Count) faceIndex = ( faceIndex % points.Count );

    return points[faceIndex];

  }

  public double[] GetRandomNumber(double minimum, double maximum, int count)
  {
    Random random = new Random();

    var rand = new Double[count];

    for( int i = 0; i < count - 1; ++i )
    {

      rand[i] = random.NextDouble() * (maximum - minimum) + minimum;

    }

    return rand;

  }

  public CurveList Curves(Brep brep)
  {

    var brp = brep;
    CurveList listaCrv = new CurveList();
    listaCrv.AddRange(brp.Loops.Select(l => l.To3dCurve()));

    List<Curve> offsetCrv = new List<Curve>();

    return listaCrv;

  }
# ---------- end c_script ----------
number_slider_2 = Slider(5, range=0..10)
msphereex = MeshSphereEx(Base=pt, Radius=Slider(10, range=0..10), Count=5)
series_2 = Series(Start=0, Step=1, Count=10)
c_script_2 = CSharpScript(x=number_slider)  # -> out, A; inputs x: Int32
# ---------- c_script_2: C# ----------
    var points = new List<Point3d>();

    for( int i = 0; i < x; ++i )
      for( int j = 0; j < x; ++j )
      {

        points.Add(new Point3d(i, j, 0.5 * ( Math.Sin(i) * Math.Cos(j) )));

      }

    A = points;
# ---------- end c_script_2 ----------
number_slider_3 = Slider(15, range=0..20)
panel = Panel(c_script.A)
pt_2 = ConstructPoint(XCoordinate=series_2, YCoordinate=0, ZCoordinate=0)
del = DelaunayMesh(Points=c_script_2.A, Plane=PlaneXY(0, 0, 0))
wbtriangles = WeaverbirdsSplitTrianglesSubdivision(MeshCurves=del, Level=Slider(10, range=0..10))
demesh = DeconstructMesh(Mesh=del)  # -> Vertices, Faces, Colours, Normals
panel_2 = Panel(demesh.Normals)
deface = DeconstructFace(Face=demesh.Faces)  # -> CornerA, CornerB, CornerC, CornerD
c_script_3 = CSharpScript(x=demesh.Vertices, y=deface.CornerA)  # -> out, A; inputs x: list of Point3d, y: Int32
# ---------- c_script_3: C# ----------
    A = ListItem(x, y);
# ---------- c_script_3: C# additional code ----------
  private Point3d ListItem(List<Point3d> points, int faceIndex)
  {

    if(faceIndex > points.Count) faceIndex = ( faceIndex % points.Count );
    
    return points[faceIndex];

  }
# ---------- end c_script_3 ----------
item = ListItem(List=demesh.Vertices, Index=deface.CornerA, Wrap=True)
panel_3 = Panel(item)
panel_4 = Panel(c_script_3.A)
item_2 = ListItem(List=demesh.Vertices, Index=deface.CornerA, Wrap=True)
panel_5 = Panel(item_2)
item_3 = ListItem(List=demesh.Vertices, Index=deface.CornerB, Wrap=True)
item_4 = ListItem(List=demesh.Vertices, Index=deface.CornerC, Wrap=True)
item_5 = ListItem(List=demesh.Vertices, Index=deface.CornerD, Wrap=True)
dom = ConstructDomain(DomainStart=Slider(0, range=0..1), DomainEnd=Slider(0.5, range=0..10))
lng = ListLength(List=demesh.Faces)
srf4pt = _4PointSurface(CornerA=item_2, CornerB=item_3, CornerC=item_4, CornerD=item_5)
random = Random(Range=dom, Number=lng, Seed=2)  # -> simplify(Random)
amp = Amplitude(Vector=demesh.Normals, Amplitude=random)
area = Area(Geometry=srf4pt)  # -> Area, Centroid
vdis = VectorDisplay(Anchor=area.Centroid, Vector=amp)
extr = Extrude(Base=srf4pt, Direction=amp)
debrep = DeconstructBrep(Brep=extr)  # -> Faces, Edges, Vertices
item_6 = ListItem(List=debrep.Faces, Index=Slider(4, range=0..10), Wrap=True)  # -> simplify(Item)
wires = BrepWireframe(Brep=item_6, Density=-1)
join = JoinCurves(Curves=wires, Preserve=False)
trisub = SubdivideTriangle(
    TriangularCurve=join,
    Subdivide=Slider(1, range=0..1),
    Boolean1=Toggle(False),
    Boolean2=Toggle(False),
    Boolean3=Toggle(False),
    Boolean4=Toggle(False),
    Wires=Toggle(False))  # -> TriangleCellsA, simplify(TriangleCellsB)
facen = FaceNormals(Mesh=item_6)  # -> Centers, Normals
lng_2 = ListLength(List=flatten(trisub.TriangleCellsB))
panel_7 = Panel(trisub.TriangleCellsB)
dom_2 = ConstructDomain(DomainStart=Slider(0, range=0..1), DomainEnd=Slider(0.5, range=0..10))
area_2 = Area(Geometry=trisub.TriangleCellsB)  # -> Area, Centroid
random_2 = Random(Range=dom_2, Number=lng_2, Seed=2)  # -> flatten(Random)
lng_3 = ListLength(List=trisub.TriangleCellsB)
branch = TreeBranch(Tree=lng_3, Path="{0}", MaintainPaths=True)
partition = PartitionList(List=random_2, Size=branch)
amp_2 = Amplitude(Vector=facen.Normals, Amplitude=partition)
vdis_2 = VectorDisplay(Anchor=area_2.Centroid, Vector=amp_2)
dom_3 = ConstructDomain(DomainStart=Slider(0.7, range=-2..1), DomainEnd=Slider(1, range=0..3))
random_3 = Random(Range=dom_3, Number=lng_2, Seed=Slider(12549129, range=0..100000000))  # -> flatten(Random)
partition_2 = PartitionList(List=random_3, Size=branch)
scale = Scale(Geometry=trisub.TriangleCellsB, Center=area_2.Centroid, Factor=partition_2)  # -> Geometry, Transform
extr_2 = Extrude(Base=scale.Geometry, Direction=amp_2)  # -> simplify(Extrusion)
debrep_2 = DeconstructBrep(Brep=extr_2)  # -> Faces, Edges, Vertices
item_7 = ListItem(List=debrep_2.Faces, Index=Slider(4, range=0..10), Wrap=True)  # -> simplify(Item)
wires_2 = BrepWireframe(Brep=item_7, Density=-1)
join_2 = JoinCurves(Curves=wires_2, Preserve=False)
trisub_2 = SubdivideTriangle(
    TriangularCurve=join_2,
    Subdivide=Slider(1, range=0..1),
    Boolean1=Toggle(False),
    Boolean2=Toggle(False),
    Boolean3=Toggle(False),
    Boolean4=Toggle(False),
    Wires=Toggle(False))  # -> TriangleCellsA, simplify(TriangleCellsB)
facen_2 = FaceNormals(Mesh=item_7)  # -> Centers, Normals
lng_4 = ListLength(List=flatten(trisub_2.TriangleCellsB))
panel_8 = Panel(trisub_2.TriangleCellsB)
dom_4 = ConstructDomain(DomainStart=Slider(0, range=0..1), DomainEnd=Slider(0.3, range=0..10))
area_3 = Area(Geometry=trisub_2.TriangleCellsB)  # -> Area, Centroid
random_4 = Random(Range=dom_4, Number=lng_4, Seed=2)  # -> flatten(Random)
lng_5 = ListLength(List=trisub_2.TriangleCellsB)
branch_2 = TreeBranch(Tree=lng_5, Path="{0;0}", MaintainPaths=True)
partition_3 = PartitionList(List=random_4, Size=branch_2)
amp_3 = Amplitude(Vector=facen_2.Normals, Amplitude=partition_3)
vdis_3 = VectorDisplay(Anchor=area_3.Centroid, Vector=amp_3)
dom_5 = ConstructDomain(DomainStart=Slider(0.3, range=-2..1), DomainEnd=Slider(1, range=0..3))
random_5 = Random(Range=dom_5, Number=lng_4, Seed=Slider(12549129, range=0..100000000))  # -> flatten(Random)
partition_4 = PartitionList(List=random_5, Size=branch_2)
scale_2 = Scale(Geometry=trisub_2.TriangleCellsB, Center=area_3.Centroid, Factor=partition_4)  # -> Geometry, Transform
extr_3 = Extrude(Base=scale_2.Geometry, Direction=amp_3)  # -> simplify(Extrusion)
debrep_3 = DeconstructBrep(Brep=extr_3)  # -> Faces, Edges, Vertices
item_8 = ListItem(List=debrep_3.Faces, Index=Slider(4, range=0..10), Wrap=True)  # -> simplify(Item)
wires_3 = BrepWireframe(Brep=item_8, Density=-1)
join_3 = JoinCurves(Curves=wires_3, Preserve=False)
trisub_3 = SubdivideTriangle(
    TriangularCurve=join_3,
    Subdivide=Slider(1, range=0..1),
    Boolean1=Toggle(False),
    Boolean2=Toggle(False),
    Boolean3=Toggle(False),
    Boolean4=Toggle(False),
    Wires=Toggle(False))  # -> TriangleCellsA, simplify(TriangleCellsB)
facen_3 = FaceNormals(Mesh=item_8)  # -> Centers, Normals
lng_6 = ListLength(List=flatten(trisub_3.TriangleCellsB))
panel_9 = Panel(trisub_3.TriangleCellsB)
dom_6 = ConstructDomain(DomainStart=Slider(0, range=0..1), DomainEnd=Slider(0.2, range=0..10))
area_4 = Area(Geometry=trisub_3.TriangleCellsB)  # -> Area, Centroid
random_6 = Random(Range=dom_6, Number=lng_6, Seed=2)  # -> flatten(Random)
lng_7 = ListLength(List=trisub_3.TriangleCellsB)
branch_3 = TreeBranch(Tree=lng_7, Path="{0;0}", MaintainPaths=True)
partition_5 = PartitionList(List=random_6, Size=branch_3)
amp_4 = Amplitude(Vector=facen_3.Normals, Amplitude=partition_5)
vdis_4 = VectorDisplay(Anchor=area_4.Centroid, Vector=amp_4)
dom_7 = ConstructDomain(DomainStart=Slider(0.3, range=-2..1), DomainEnd=Slider(1, range=0..3))
random_7 = Random(Range=dom_7, Number=lng_6, Seed=Slider(12549129, range=0..100000000))  # -> flatten(Random)
partition_6 = PartitionList(List=random_7, Size=branch_3)
scale_3 = Scale(Geometry=trisub_3.TriangleCellsB, Center=area_4.Centroid, Factor=partition_6)  # -> Geometry, Transform
extr_4 = Extrude(Base=scale_3.Geometry, Direction=amp_4)  # -> simplify(Extrusion)
debrep_4 = DeconstructBrep(Brep=extr_4)  # -> Faces, Edges, Vertices
item_9 = ListItem(List=debrep_4.Faces, Index=Slider(4, range=0..10), Wrap=True)  # -> simplify(Item)
wires_4 = BrepWireframe(Brep=item_9, Density=-1)
join_4 = JoinCurves(Curves=wires_4, Preserve=False)
trisub_4 = SubdivideTriangle(
    TriangularCurve=join_4,
    Subdivide=Slider(1, range=0..1),
    Boolean1=Toggle(False),
    Boolean2=Toggle(False),
    Boolean3=Toggle(False),
    Boolean4=Toggle(False),
    Wires=Toggle(False))  # -> TriangleCellsA, simplify(TriangleCellsB)
facen_4 = FaceNormals(Mesh=item_9)  # -> Centers, Normals
lng_8 = ListLength(List=flatten(trisub_4.TriangleCellsB))
panel_10 = Panel(trisub_4.TriangleCellsB)  # disabled
dom_8 = ConstructDomain(DomainStart=Slider(0, range=0..1), DomainEnd=Slider(0.1, range=0..10))
area_5 = Area(Geometry=trisub_4.TriangleCellsB)  # -> Area, Centroid
random_8 = Random(Range=dom_8, Number=lng_8, Seed=2)  # -> flatten(Random)
lng_9 = ListLength(List=trisub_4.TriangleCellsB)
branch_4 = TreeBranch(Tree=lng_9, Path="{0;0}", MaintainPaths=True)
partition_7 = PartitionList(List=random_8, Size=branch_4)
amp_5 = Amplitude(Vector=facen_4.Normals, Amplitude=partition_7)
vdis_5 = VectorDisplay(Anchor=area_5.Centroid, Vector=amp_5)
dom_9 = ConstructDomain(DomainStart=Slider(0.3, range=-2..1), DomainEnd=Slider(1, range=0..3))
random_9 = Random(Range=dom_9, Number=lng_8, Seed=Slider(12549129, range=0..100000000))  # -> flatten(Random)
partition_8 = PartitionList(List=random_9, Size=branch_4)
scale_4 = Scale(Geometry=trisub_4.TriangleCellsB, Center=area_5.Centroid, Factor=partition_8)  # -> Geometry, Transform
extr_5 = Extrude(Base=scale_4.Geometry, Direction=amp_5)  # -> simplify(Extrusion)
merge = Merge(Data1=extr, Data2=extr_2, Data3=extr_3, Data4=extr_4, Data5=extr_5)
debrep_5 = DeconstructBrep(Brep=extr_5)  # -> Faces, Edges, Vertices; disabled
number_slider_4 = Slider(4, range=0..10)  # disabled
scale_5 = Scale(Center=Point(0, 0, 0), Factor=0.5)  # -> Geometry, Transform; disabled
item_10 = ListItem(List=debrep_5.Faces, Index=number_slider_4, Wrap=True)  # -> simplify(Item); disabled
wires_5 = BrepWireframe(Brep=item_10, Density=-1)  # disabled
join_5 = JoinCurves(Curves=wires_5, Preserve=False)  # disabled
number_slider_5 = Slider(1, range=0..1)  # disabled
toggle = BooleanToggle(False)  # disabled
toggle_2 = BooleanToggle(False)  # disabled
toggle_3 = BooleanToggle(False)  # disabled
toggle_4 = BooleanToggle(False)  # disabled
toggle_5 = BooleanToggle(False)  # disabled
trisub_5 = SubdivideTriangle(
    TriangularCurve=join_5,
    Subdivide=number_slider_5,
    Boolean1=toggle_2,
    Boolean2=toggle,
    Boolean3=toggle_3,
    Boolean4=toggle_4,
    Wires=toggle_5)  # -> TriangleCellsA, simplify(TriangleCellsB); disabled
number_slider_6 = Slider(0, range=0..1)  # disabled
number_slider_7 = Slider(0.3, range=0..10)  # disabled
facen_5 = FaceNormals(Mesh=item_10)  # -> Centers, Normals; disabled
lng_10 = ListLength(List=flatten(trisub_5.TriangleCellsB))  # disabled
panel_11 = Panel(trisub_5.TriangleCellsB)  # disabled
dom_10 = ConstructDomain(DomainStart=number_slider_6, DomainEnd=number_slider_7)  # disabled
area_6 = Area(Geometry=trisub_5.TriangleCellsB)  # -> Area, Centroid; disabled
random_10 = Random(Range=dom_10, Number=lng_10, Seed=2)  # -> flatten(Random); disabled
lng_11 = ListLength(List=trisub_5.TriangleCellsB)  # disabled
panel_12 = Panel("{0;0}")  # disabled
branch_5 = TreeBranch(Tree=lng_11, Path=panel_12, MaintainPaths=True)  # disabled
partition_9 = PartitionList(List=random_10, Size=branch_5)  # disabled
amp_6 = Amplitude(Vector=facen_5.Normals, Amplitude=partition_9)  # disabled
vdis_6 = VectorDisplay(Anchor=area_6.Centroid, Vector=amp_6)  # disabled
number_slider_8 = Slider(0.3, range=-2..1)  # disabled
number_slider_9 = Slider(1, range=0..3)  # disabled
dom_11 = ConstructDomain(DomainStart=number_slider_8, DomainEnd=number_slider_9)  # disabled
number_slider_10 = Slider(12549129, range=0..100000000)  # disabled
random_11 = Random(Range=dom_11, Number=lng_10, Seed=number_slider_10)  # -> flatten(Random); disabled
partition_10 = PartitionList(List=random_11, Size=branch_5)  # disabled
scale_6 = Scale(Geometry=trisub_5.TriangleCellsB, Center=area_6.Centroid, Factor=partition_10)  # -> Geometry, Transform; disabled
extr_6 = Extrude(Base=scale_6.Geometry, Direction=amp_6)  # -> simplify(Extrusion); disabled
